# Grasshopper definition ShapefileIO.gh (Grasshopper 1.0.7)

# ---- group: Library References / Mac Rhino & Grasshopper Libraries
libraries = Panel("""RhinoCommon.dll
ManagedPlugIns/GrasshopperPlugin.rhp/Grasshopper.dll
ManagedPlugIns/GrasshopperPlugin.rhp/GH_IO.dll
ManagedPlugIns/GrasshopperPlugin.rhp/GH_Util.dll""")
application_directory = Panel("/Applications/Rhinoceros.app/Contents/Frameworks/RhCore.framework/Versions/Current/Resources/")

# ---- group: Library References / Windows Rhino & Grasshopper Libraries
libraries_2 = Panel("""System\RhinoCommon.dll
Plug-ins\Grasshopper\Grasshopper.dll
Plug-ins\Grasshopper\GH_IO.dll
Plug-ins\Grasshopper\GH_Util.dll""")
application_directory_2 = Panel("C:\Program Files\Rhino 6\")

# ---- group: Library References / Project-specific Libraries
libraries_3 = Panel("""packages/NetTopologySuite.Core.1.15.3/lib/net45/NetTopologySuite.dll
packages/NetTopologySuite.IO.1.14.0.1/lib/net45/NetTopologySuite.IO.dll
packages/NetTopologySuite.IO.1.14.0.1/lib/net45/NetTopologySuite.IO.ShapeFile.dll
packages/NetTopologySuite.IO.1.14.0.1/lib/net45/NetTopologySuite.IO.GeoTools.dll
packages/NetTopologySuite.IO.1.14.0.1/lib/net45/NetTopologySuite.IO.ShapeFile.Extended.dll
packages/GeoAPI.Core.1.7.5/lib/net45/GeoAPI.dll""")
c_script = CSharpScript()  # -> P
# ---------- c_script: C# ----------
Component.Message = "Current FilePath";

if (owner.OnPingDocument().IsFilePathDefined)
{
    var filePaths = owner.OnPingDocument().FilePath.Split(Path.DirectorySeparatorChar);
    var dirPaths = filePaths.Take(filePaths.Count() - 1).ToArray();
    var dirPath = String.Join(Path.DirectorySeparatorChar, dirPaths);
    P = dirPath + Path.DirectorySeparatorChar;
}
else
{
    throw new Exception("Grasshopper Document has not yet been saved");
}
# ---------- end c_script ----------

# ----
libraries_4 = Panel("""/Library/Frameworks/Mono.framework/Versions/6.4.0/lib/mono/4.7.2-api/System.Data.dll
/Library/Frameworks/Mono.framework/Versions/6.4.0/lib/mono/4.7.2-api/System.dll
/Library/Frameworks/Mono.framework/Versions/6.4.0/lib/mono/4.7.2-api/System.Xml.dll""")
crv = Curve(Tree({0}: [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], {1}: [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], {2}: [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]))
pt = Point(Point(-3, 8, 0))

# ---- group: Library References / Mac Rhino & Grasshopper Libraries
concat = Concatenate(FragmentA=application_directory, FragmentB=libraries)

# ---- group: Library References / Windows Rhino & Grasshopper Libraries
concat_2 = Concatenate(FragmentA=application_directory_2, FragmentB=libraries_2)

# ---- group: Library References / Project-specific Libraries
concat_3 = Concatenate(FragmentA=c_script, FragmentB=libraries_3)

# ---- group: Library References
windows = BooleanToggle(False)
filter = StreamFilter(Gate=windows, Stream0=concat, Stream1=concat_2)

# ----
panel = Panel("/Volumes/Data/Git/antelope/shp/nyc_mappluto_19v2_shp/MapPLUTO.shp")

# ---- group: Script File
# Link to the .cs file in the vs project
panel_2 = Panel("LoadShapefile.cs")
c_script_2 = CSharpScript()  # -> P; same code as c_script
concat_4 = Concatenate(FragmentA=c_script_2, FragmentB=panel_2)
file = ReadFile(File=concat_4, PerLineParse=False)

# ---- group: Library References
merge = Merge(Data1=filter, Data2=concat_3, Data3=libraries_4)
path = FilePath(merge)

# ----
file_2 = ReadFile(File="/Volumes/Data/Git/parasiteTest/ScriptComponentA.cs", PerLineParse=False)
c_script_3 = CSharpScript(script=file_2, pt=pt, crvs=crv)  # -> out, Parameters; inputs script: String, pt: Point3d, crvs: list of Curve
# ---------- c_script_3: C# ----------
    var provider = new Microsoft.CSharp.CSharpCodeProvider();
    var parameters = new System.CodeDom.Compiler.CompilerParameters();

    parameters.ReferencedAssemblies.Add(@"/Applications/Rhinoceros.app/Contents/Frameworks/RhCore.framework/Versions/Current/Resources/RhinoCommon.dll");
    parameters.ReferencedAssemblies.Add(@"/Applications/Rhinoceros.app/Contents/Frameworks/RhCore.framework/Versions/Current/Resources/ManagedPlugIns/GrasshopperPlugin.rhp/Grasshopper.dll");
    parameters.ReferencedAssemblies.Add(@"/Applications/Rhinoceros.app/Contents/Frameworks/RhCore.framework/Versions/Current/Resources/ManagedPlugIns/GrasshopperPlugin.rhp/GH_IO.dll");
    parameters.ReferencedAssemblies.Add(@"/Applications/Rhinoceros.app/Contents/Frameworks/RhCore.framework/Versions/Current/Resources/ManagedPlugIns/GrasshopperPlugin.rhp/GH_Util.dll");
    // True - memory generation, False - external file generation
    parameters.GenerateInMemory = true;
    // True - exe file generation, False - dll file generation
    parameters.GenerateExecutable = false;

    var results = provider.CompileAssemblyFromSource(parameters, script);

    if (results.Errors.HasErrors)
    {
      string errMes = "";
      for (int i = 0; i < results.Errors.Count; i++)
      {
        var err = results.Errors[i];
        errMes += err.Line + " " + err.ErrorText + "\n";
      }

      throw new Exception("Compiling failed\n\n" + errMes);
    }

    var assembly = results.CompiledAssembly;


    InitAssembly(assembly);
    System.Reflection.MethodInfo runscript = _instance.GetType().GetMethod("RunScript");


    //*****************
    // Define input in here, by copying from the signature
    //*****************
    var input = new List<object>(){  pt  , crvs };


    var output = new List<object>();
    runscript.Invoke(_instance, new object[]{input, output});

    //*****************
    // Define Output
    //*****************
    Parameters = output[0];
# ---------- c_script_3: C# additional code ----------
  System.Reflection.Assembly _assemblyInstance = null;
  object _instance = null;

  /// <summary>
  /// This method will be called once every solution, before any calls to RunScript.
  /// </summary>
  public override void BeforeRunScript()
  {
    _assemblyInstance = null;

  }
  private void InitAssembly(System.Object assembly)
  {
    if (_assemblyInstance == null)
    {
      _assemblyInstance = (System.Reflection.Assembly) assembly;
      var classType = _assemblyInstance.GetType("RhinoCS_GH.GHScriptInstance");
      System.Reflection.ConstructorInfo ctor = classType.GetConstructor(new[] {typeof(GH_Component)});
      _instance = ctor.Invoke(new object[] {Component});
    }
  }
# ---------- end c_script_3 ----------

c_script_4 = CSharpScript(L=path, S=file, F=panel)  # -> out, A; inputs L: list of String, S: String, F: String
# ---------- c_script_4: C# ----------
    var provider = new Microsoft.CSharp.CSharpCodeProvider();
    var parameters = new System.CodeDom.Compiler.CompilerParameters();

    foreach (var library in L)
    {
      parameters.ReferencedAssemblies.Add(@library);
    }
    parameters.GenerateInMemory = true;
    parameters.GenerateExecutable = false;

    var results = provider.CompileAssemblyFromSource(parameters, S);
    CheckResults(results);

    var assembly = results.CompiledAssembly;
    InitializeAssembly(assembly);
    System.Reflection.MethodInfo runscript = _instance.GetType().GetMethod("RunScript");


    //*****************
    // Define input in here, by copying from the signature
    //*****************
    var input = new List<object>() { F };
    var output = new List<object>();


    runscript.Invoke(_instance, new object[]{input, output});

    //*****************
    // Define Output
    //*****************
    A = output[0];
# ---------- c_script_4: C# additional code ----------
  public void CheckResults(System.CodeDom.Compiler.CompilerResults results)
  {
    if (results.Errors.HasErrors)
    {
      string errMes = "";
      for (int i = 0; i < results.Errors.Count; i++)
      {
        var err = results.Errors[i];
        errMes += err.Line + " " + err.ErrorText + "\n";
      }
      throw new Exception("Compiling failed\n\n" + errMes);
    }
  }

  System.Reflection.Assembly _assemblyInstance = null;
  object _instance = null;

  public override void BeforeRunScript()
  {
    _assemblyInstance = null;
  }

  private void InitializeAssembly(object assembly)
  {
    if (_assemblyInstance == null)
    {
      _assemblyInstance = (System.Reflection.Assembly) assembly;
      var classType = _assemblyInstance.GetType("Grasshopper.ScriptableComponent");
      System.Reflection.ConstructorInfo ctor = classType.GetConstructor(new[] {typeof(GH_Component)});
      _instance = ctor.Invoke(new object[] {Component});
    }
  }
# ---------- end c_script_4 ----------
# This is the script component:
# 
# change input and output like you are used to,
# but also within the file
c_script_5 = CSharpScript(script=file_2, pt=pt, crvs=crv)  # -> out, Parameters; inputs script: String, pt: Point3d, crvs: list of Curve; same code as c_script_3
panel_3 = Panel(c_script_4.out)
panel_4 = Panel(c_script_4.A)
eval = EvaluateCurve(Curve=crv, Parameter=c_script_3.Parameters)  # -> Point, Tangent, Angle
# The compiler
# 
# only change compiler,
# if your rh and gh assemblies
# are located somewhere else
panel_5 = Panel(c_script_4.A)
